# Dynamo graph 8252023 Parametric JOurnal Dynamo Script.dyn (Dynamo 2.13.1.3887)
# packages: Genius Loci 2022.9.16, Clockwork for Dynamo 2.x 2.4.0, spring nodes 204.1.0, Rhythm 2017.1.8

# group: Wall and Element Parameters
categories = Categories("OST_Walls")
all_elements_of_category = ElementsOfCategory(Category=categories)
wall_material_number = Element.GetMaterials(element=all_elements_of_category)
name = Material.Name(material=wall_material_number)
material_libarary_location = Directory("C:\Users\Austin\OneDrive - The Pennsylvania State University\497 Dr. Hu\Class Project\CMU")
loadNeededElementsForWalls = Custom[LoadNeededElementsForWalls](WallMaterials=name, Directory=material_libarary_location)
loadFamily = Custom[Document.LoadFamily](path=loadNeededElementsForWalls)  # package Clockwork for Dynamo 2.x; A very crude implementation of family loading. Will *not* reload an already loaded family of the same name.
flatten = List.Flatten(list=loadFamily.familyTypes@L2)
unjoinAllGeometry = Element.UnjoinAllGeometry(elements=all_elements_of_category)
wall_edges_references = Custom[Wall Edges References](wall=unjoinAllGeometry)  # package Genius Loci; Get the vertical and horizontal edges and their references from the exterior and interior faces. Also works with linked walls.
string = StringInput("Unconnected Height")
wall_heights = Element.GetParameterValueByName(element=unjoinAllGeometry, parameterName=string)
blockParameters = Custom[BlockParameters](list=flatten)

# group: Referance Edge Filter
filterOutUpperReferanceEdge = Custom[FilterOutUpperReferanceEdge](curve=wall_edges_references.Exterior_Side_Horizontal_Edges, z=wall_heights)
list_clean = Custom[List Clean](list=filterOutUpperReferanceEdge)  # package Genius Loci; Removes all Null, Empty and Blank from a list or nested list of lists.
flatten_2 = List.Flatten(list=list_clean@L2)
wall_start_locations = Curve.StartPoint(curve=flatten_2)
code_block = CodeBlock { 1; }
flatten_3 = List.Flatten(list=wall_start_locations, amount=code_block)
endPoint = Curve.EndPoint(curve=flatten_2)

# group: Adjustments
list_create = List.Create(item0=flatten_2, item1=blockParameters.Length)
transpose = List.Transpose(lists=list_create)
flatten_4 = List.Flatten(list=transpose@L3)
lastItem = List.LastItem(list=flatten_4@L2)
code_block_2 = CodeBlock { 1.3333333333333333; }
isNull = Object.IsNull()  # unwired: object
elementLenght = Replace(item=lastItem, replaceWith=code_block_2, condition=isNull)
list_create_2 = List.Create(item0=flatten_2, item1=wall_heights)
transpose_2 = List.Transpose(lists=list_create_2)
flatten_5 = List.Flatten(list=transpose_2@L3)
lastItem_2 = List.LastItem(list=flatten_5@L2)
code_block_3 = CodeBlock { 10; }
elementLenght_2 = Replace(item=lastItem_2, replaceWith=code_block_3, condition=isNull)
list_create_3 = List.Create(item0=flatten_2, item1=blockParameters.Height)
transpose_3 = List.Transpose(lists=list_create_3)
flatten_6 = List.Flatten(list=transpose_3@L3)
lastItem_3 = List.LastItem(list=flatten_6@L2)
code_block_4 = CodeBlock { 0.666666666666667; }
elementHeight = Replace(item=lastItem_3, replaceWith=code_block_4, condition=isNull)

# group: BottomRowSetup
BOTTOMROWLOCATIONCREATION = Curve.PointsAtChordLengthFromPoint(curve=flatten_2, point=flatten_3, chordLength=elementLenght)
flatten_7 = List.Flatten(list=BOTTOMROWLOCATIONCREATION@L2)
most_block_locations_bottom_row = Custom[Most block locations-bottom row](list=flatten_7@@L2)  # package Clockwork for Dynamo 2.x; Drops the last item from a given list.
flatten_8 = List.Flatten(list=most_block_locations_bottom_row@L2)
list_create_4 = List.Create(item0=wall_start_locations, item1=flatten_8)
transpose_4 = List.Transpose(lists=list_create_4@L4)
allFirstRowCoordinates = List.Flatten(list=transpose_4@L3)
partial_element_start_locations = List.LastItem(list=BOTTOMROWLOCATIONCREATION@L2)

# group: Full Block Locations: Odd Rows
zdirection_upanddown = Vector.ZAxis()
Z = Point.Z(point=allFirstRowCoordinates)  # frozen
code_block_5 = CodeBlock(WallHeight=elementLenght_2, BlockHeight=elementHeight, z=Z) { WallHeight; BlockHeight; z; ShortWallHieght=WallHeight-z; }
byStartPointDirectionLength = Line.ByStartPointDirectionLength(startPoint=allFirstRowCoordinates, direction=zdirection_upanddown, length=code_block_5.ShortWallHieght)
half_of_element_height = CodeBlock(ElementHeight=code_block_5.BlockHeight) { ElementHeight*2; }
pointsAtChordLengthFromPoint = Curve.PointsAtChordLengthFromPoint(curve=byStartPointDirectionLength, point=allFirstRowCoordinates, chordLength=half_of_element_height)
flatten_9 = List.Flatten(list=pointsAtChordLengthFromPoint@L3)
list_create_5 = List.Create(item0=allFirstRowCoordinates, item1=flatten_9)
transpose_5 = List.Transpose(lists=list_create_5@L4)
allFirstRowCoordinates_2 = List.Flatten(list=transpose_5@L3)

# group: SecondRowReferanceLineSetup
direction = Line.Direction(line=flatten_2)  # frozen
block_courses_offset_for_row = DoubleSlider(50, range=0..100 step 1)
element_adjustment_factors = CodeBlock(CourseMoveFactor=block_courses_offset_for_row, LengthOfElement=elementLenght)
# ---------- element_adjustment_factors.designscript (5 lines) ----------
CourseMoveFactor;
LengthOfElement;
Percent=CourseMoveFactor/100;
AmountToMoveElements=Percent*LengthOfElement;
X=-1*AmountToMoveElements;
# ----------------------------------------
move_course_left_right = Geometry.Translate(geometry=wall_start_locations, direction=direction, distance=element_adjustment_factors.AmountToMoveElements)
ZAxis = Vector.ZAxis()
elementHeight_2 = CodeBlock(ElementHeight=elementHeight) { ElementHeight; }
startLocations = Geometry.Translate(geometry=move_course_left_right, direction=ZAxis, distance=elementHeight_2)
move_course_left_right_2 = Geometry.Translate(geometry=endPoint, direction=direction, distance=element_adjustment_factors.X)
endLocations = Geometry.Translate(geometry=move_course_left_right_2, direction=ZAxis, distance=elementHeight_2)
secondRowRefernaceLine = Line.ByStartPointEndPoint(startPoint=startLocations, endPoint=endLocations)
partial_endpoint = Geometry.Translate(geometry=endPoint, direction=ZAxis, distance=elementHeight_2)
partial_startpoint = Geometry.Translate(geometry=wall_start_locations, direction=ZAxis, distance=elementHeight_2)

# group: Even Row Setup
BOTTOMROWLOCATIONCREATION_2 = Curve.PointsAtChordLengthFromPoint(curve=secondRowRefernaceLine, point=startLocations, chordLength=elementLenght)
flatten_10 = List.Flatten(list=BOTTOMROWLOCATIONCREATION_2@L3)
most_block_locations_bottom_row_2 = Custom[Most block locations-bottom row](list=flatten_10@@L2)
createandMergeList = Custom[CreateandMergeList](startLocations, most_block_locations_bottom_row_2)

# group: Full Block Locations: Even Rows
zdirection_upanddown_2 = Vector.ZAxis()
Z_2 = Point.Z(point=createandMergeList)
code_block_6 = CodeBlock(WallHeight=elementLenght_2, BlockHeight=elementHeight, z=Z_2) { WallHeight; BlockHeight; z; ShortWallHieght=WallHeight-z-BlockHeight; }
byStartPointDirectionLength_2 = Line.ByStartPointDirectionLength(startPoint=createandMergeList, direction=zdirection_upanddown_2, length=code_block_6.ShortWallHieght)
half_of_element_height_2 = CodeBlock(ElementHeight=code_block_6.BlockHeight) { ElementHeight*2; }
pointsAtChordLengthFromPoint_2 = Curve.PointsAtChordLengthFromPoint(curve=byStartPointDirectionLength_2, point=createandMergeList, chordLength=half_of_element_height_2)
list_create_6 = List.Create(item0=createandMergeList, item1=pointsAtChordLengthFromPoint_2)
transpose_6 = List.Transpose(lists=list_create_6)
allFirstRowCoordinates_3 = List.Flatten(list=transpose_6@@L4)

# group: Placing Full Sized Elements
allFirstRowCoordinates_4 = List.Flatten(list=flatten)
firstItem = List.FirstItem(list=allFirstRowCoordinates_4)
list_create_7 = List.Create(item0=allFirstRowCoordinates_2, item1=allFirstRowCoordinates_3)
transpose_7 = List.Transpose(lists=list_create_7@L4)
allFirstRowCoordinates_5 = List.Flatten(list=transpose_7@L3)
byPoint = FamilyInstance.ByPoint(familyType=firstItem, point=allFirstRowCoordinates_5)
XAxis = Vector.XAxis()
angleWithVector = Vector.AngleWithVector(vector=direction@L1, otherVector=XAxis)
code_block_7 = CodeBlock(y=angleWithVector) { Math.Round(y,1); }
element_setrotation = Custom[Element SetRotation](element=byPoint, degree=code_block_7)  # package Genius Loci; Set the angle of the element around its local Z-axis. (Same as the Rotate command in Revit)
setLocation = Element.SetLocation(element=element_setrotation, geometry=allFirstRowCoordinates_5)

# group: Partial Block Locations: Odd Rows Start Locations
zdirection_upanddown_3 = Vector.ZAxis()
Z_3 = Point.Z(point=partial_element_start_locations)  # frozen
code_block_8 = CodeBlock(WallHeight=elementLenght_2, BlockHeight=elementHeight, z=Z_3) { WallHeight; BlockHeight; z; ShortWallHieght=WallHeight-z; }
byStartPointDirectionLength_3 = Line.ByStartPointDirectionLength(startPoint=partial_element_start_locations@L2, direction=zdirection_upanddown_3, length=code_block_8.ShortWallHieght)
half_of_element_height_3 = CodeBlock(ElementHeight=elementHeight) { ElementHeight*2; }
pointsAtChordLengthFromPoint_3 = Curve.PointsAtChordLengthFromPoint(curve=byStartPointDirectionLength_3, point=partial_element_start_locations, chordLength=half_of_element_height_3)
flatten_11 = List.Flatten(list=pointsAtChordLengthFromPoint_3@L2)
list_create_8 = List.Create(item0=partial_element_start_locations, item1=flatten_11)
transpose_8 = List.Transpose(lists=list_create_8@L4)

# group: Partial Block Locations: Odd Rows Start Locations
zdirection_upanddown_4 = Vector.ZAxis()
Z_4 = Point.Z(point=endPoint)  # frozen
code_block_9 = CodeBlock(WallHeight=elementLenght_2, BlockHeight=elementHeight, z=Z_4) { WallHeight; BlockHeight; z; ShortWallHieght=WallHeight-z; }
byStartPointDirectionLength_4 = Line.ByStartPointDirectionLength(startPoint=endPoint, direction=zdirection_upanddown_4, length=code_block_9.ShortWallHieght)
half_of_element_height_4 = CodeBlock(ElementHeight=elementHeight) { ElementHeight*2; }
pointsAtChordLengthFromPoint_4 = Curve.PointsAtChordLengthFromPoint(curve=byStartPointDirectionLength_4, point=endPoint, chordLength=half_of_element_height_4)
flatten_12 = List.Flatten(list=pointsAtChordLengthFromPoint_4@L2)
list_create_9 = List.Create(item0=endPoint, item1=flatten_12)
transpose_9 = List.Transpose(lists=list_create_9@L4)
lower_start = List.Flatten(list=transpose_9@L3)

# group: Size Partail Blocks-Even Rows End
lower_start_2 = List.Flatten(list=transpose_8@L3)
zdirection_upanddown_5 = Vector.ZAxis()
half_of_element_height_5 = CodeBlock(ElementHeight=elementHeight) { ElementHeight*2; X=ElementHeight; }
upper_start = Geometry.Translate(geometry=lower_start_2, direction=zdirection_upanddown_5, distance=half_of_element_height_5.X)
upper_end = Geometry.Translate(geometry=lower_start, direction=zdirection_upanddown_5, distance=half_of_element_height_5.X)
byCornerPoints = Rectangle.ByCornerPoints(p1=lower_start_2, p2=upper_start, p3=upper_end, p4=lower_start)
extrudeAsSolid = Curve.ExtrudeAsSolid(curve=byCornerPoints, distance=elementHeight)
boundingBox = Geometry.BoundingBox(geometry=extrudeAsSolid)
toCuboid = BoundingBox.ToCuboid(boundingBox=boundingBox)

# group: Naming Partial Blocks by Size
width = Cuboid.Width(cuboid=toCuboid)
code_block_10 = CodeBlock(x=width) { x*12; }
code_block_11 = CodeBlock { 2; }
round = Math.Round(number=code_block_10, digits=code_block_11)
ꟿ_number_tostring = Custom[ꟿ Number.ToString](num=round, digits=code_block_11)  # package spring nodes; Converts the input number(s) to string. You can optionally limit the number of digits.
code_block_12 = CodeBlock(x=ꟿ_number_tostring) { "8X8X"+x; }
string_from_object = FromObject(object=code_block_12)
height = Cuboid.Height(cuboid=toCuboid)

# group: Partail Block First Row Type Creation
categories_2 = Categories("OST_GenericModel")
file_path = Filename("..\..\..\..\..\..\ProgramData\Autodesk\RVT 2023\Family Templates\English-Imperial\Generic Model.rft")
code_block_13 = CodeBlock { Material1=Material.ByName("Default"); }
code_block_14 = CodeBlock { "Generic Model"; }
byGeometry = FamilyType.ByGeometry(solidGeometry=toCuboid, name=string_from_object, category=categories_2, templatePath=file_path, material=code_block_13, subcategory=code_block_14)
minPoint = BoundingBox.MinPoint(boundingBox=boundingBox)
byPoint_2 = FamilyInstance.ByPoint(familyType=byGeometry, point=minPoint)
code_block_15 = CodeBlock(y=angleWithVector) { Math.Round(y,1); }
element_setrotation_2 = Custom[Element SetRotation](element=byPoint_2, degree=code_block_15)
setLocation_2 = Element.SetLocation(element=element_setrotation_2, geometry=transpose_8)
code_block_16 = CodeBlock { "Length"; "Depth"; "Height"; }
code_block_17 = CodeBlock(Depth=height, Height=height, Lenght=width) { Depth; Height; Lenght; }
setparameterbyname = Custom[SetParameterByName(TypeOrInstance)](element=element_setrotation_2, parameterName=code_block_16.out0, value=code_block_17.Lenght)  # package Rhythm; Set one of the element's parameters regardless of parameter type or instance.
setparameterbyname_2 = Custom[SetParameterByName(TypeOrInstance)](element=element_setrotation_2, parameterName=code_block_16.out2, value=code_block_17.Height)
setparameterbyname_3 = Custom[SetParameterByName(TypeOrInstance)](element=element_setrotation_2, parameterName=code_block_16.out1, value=code_block_17.Depth)

# group: Partial Block Locations: Even Rows Start Locations end Correct
zdirection_upanddown_6 = Vector.ZAxis()
Z_5 = Point.Z(point=partial_endpoint)
code_block_18 = CodeBlock(WallHeight=elementLenght_2, BlockHeight=elementHeight, z=Z_5) { WallHeight; BlockHeight; z; ShortWallHieght=WallHeight-z-BlockHeight; }
byStartPointDirectionLength_5 = Line.ByStartPointDirectionLength(startPoint=partial_endpoint, direction=zdirection_upanddown_6, length=code_block_18.ShortWallHieght)
half_of_element_height_6 = CodeBlock(ElementHeight=code_block_18.BlockHeight) { ElementHeight*2; }
pointsAtChordLengthFromPoint_5 = Curve.PointsAtChordLengthFromPoint(curve=byStartPointDirectionLength_5, point=partial_endpoint, chordLength=half_of_element_height_6)
list_create_10 = List.Create(item0=partial_endpoint, item1=pointsAtChordLengthFromPoint_5)
transpose_10 = List.Transpose(lists=list_create_10)
allFirstRowCoordinates_6 = List.Flatten(list=transpose_10@L4)

# group: Partial Block Locations: Even Rows Start Locations end
code_block_19 = CodeBlock(X=BOTTOMROWLOCATIONCREATION_2) { X; }
lastItem_4 = List.LastItem(list=code_block_19@@L2)
zdirection_upanddown_7 = Vector.ZAxis()
Z_6 = Point.Z(point=lastItem_4)
code_block_20 = CodeBlock(WallHeight=elementLenght_2, BlockHeight=elementHeight, z=Z_6) { WallHeight; BlockHeight; z; ShortWallHieght=WallHeight-z-BlockHeight; }
byStartPointDirectionLength_6 = Line.ByStartPointDirectionLength(startPoint=lastItem_4, direction=zdirection_upanddown_7, length=code_block_20.ShortWallHieght)
half_of_element_height_7 = CodeBlock(ElementHeight=code_block_20.BlockHeight) { ElementHeight*2; }
pointsAtChordLengthFromPoint_6 = Curve.PointsAtChordLengthFromPoint(curve=byStartPointDirectionLength_6, point=lastItem_4, chordLength=half_of_element_height_7)
list_create_11 = List.Create(item0=lastItem_4, item1=pointsAtChordLengthFromPoint_6)
transpose_11 = List.Transpose(lists=list_create_11)
allFirstRowCoordinates_7 = List.Flatten(list=transpose_11@L4)

# group: Partial Block Locations: Even Rows Start Locations
Z_7 = Point.Z(point=startLocations)
code_block_21 = CodeBlock(WallHeight=elementLenght_2, BlockHeight=elementHeight, z=Z_7) { WallHeight; BlockHeight; z; ShortWallHieght=WallHeight-z-BlockHeight; }
half_of_element_height_8 = CodeBlock(ElementHeight=code_block_21.BlockHeight) { ElementHeight*2; X=ElementHeight; }
zdirection_upanddown_8 = Vector.ZAxis()
byStartPointDirectionLength_7 = Line.ByStartPointDirectionLength(startPoint=startLocations, direction=zdirection_upanddown_8, length=code_block_21.ShortWallHieght)
pointsAtChordLengthFromPoint_7 = Curve.PointsAtChordLengthFromPoint(curve=byStartPointDirectionLength_7, point=createandMergeList, chordLength=half_of_element_height_8.out0)
list_create_12 = List.Create(item0=startLocations, item1=pointsAtChordLengthFromPoint_7)
transpose_12 = List.Transpose(lists=list_create_12)
startpoint_partial_even = List.Flatten(list=transpose_12@@L4)

# group: Size Partail Blocks-Even Rows End
zdirection_upanddown_9 = Vector.ZAxis()
translate = Geometry.Translate(geometry=allFirstRowCoordinates_7, direction=zdirection_upanddown_9, distance=half_of_element_height_8.X)
translate_2 = Geometry.Translate(geometry=allFirstRowCoordinates_6, direction=zdirection_upanddown_9, distance=half_of_element_height_8.X)
byCornerPoints_2 = Rectangle.ByCornerPoints(p1=allFirstRowCoordinates_6, p2=allFirstRowCoordinates_7, p3=translate, p4=translate_2)
extrudeAsSolid_2 = Curve.ExtrudeAsSolid(curve=byCornerPoints_2, distance=elementHeight)
boundingBox_2 = Geometry.BoundingBox(geometry=extrudeAsSolid_2)
toCuboid_2 = BoundingBox.ToCuboid(boundingBox=boundingBox_2)

# group: Naming Partial Blocks by Size
width_2 = Cuboid.Width(cuboid=toCuboid_2)
code_block_22 = CodeBlock(x=width_2) { x*12; }
code_block_23 = CodeBlock { 2; }
round_2 = Math.Round(number=code_block_22, digits=code_block_23)
ꟿ_number_tostring_2 = Custom[ꟿ Number.ToString](num=round_2, digits=code_block_23)
code_block_24 = CodeBlock(x=ꟿ_number_tostring_2) { "8X8X"+x; }
string_from_object_2 = FromObject(object=code_block_24)
height_2 = Cuboid.Height(cuboid=toCuboid_2)

# group: Partail Block First Row Type Creation
categories_3 = Categories("OST_GenericModel")
file_path_2 = Filename("..\..\..\..\..\..\ProgramData\Autodesk\RVT 2023\Family Templates\English-Imperial\Generic Model.rft")
code_block_25 = CodeBlock { Material1=Material.ByName("Default"); }
code_block_26 = CodeBlock { "Generic Model"; }
byGeometry_2 = FamilyType.ByGeometry(solidGeometry=toCuboid_2, name=string_from_object_2, category=categories_3, templatePath=file_path_2, material=code_block_25, subcategory=code_block_26)
minPoint_2 = BoundingBox.MinPoint(boundingBox=boundingBox_2)
byPoint_3 = FamilyInstance.ByPoint(familyType=byGeometry_2, point=minPoint_2)
code_block_27 = CodeBlock(y=angleWithVector) { Math.Round(y,1); }
element_setrotation_3 = Custom[Element SetRotation](element=byPoint_3, degree=code_block_27)
setLocation_3 = Element.SetLocation(element=element_setrotation_3, geometry=allFirstRowCoordinates_7)
code_block_28 = CodeBlock { "Length"; "Depth"; "Height"; }
code_block_29 = CodeBlock(Depth=height_2, Height=height_2, Lenght=width_2) { Depth; Height; Lenght; }
setparameterbyname_4 = Custom[SetParameterByName(TypeOrInstance)](element=element_setrotation_3, parameterName=code_block_28.out0, value=code_block_29.Lenght)
setparameterbyname_5 = Custom[SetParameterByName(TypeOrInstance)](element=element_setrotation_3, parameterName=code_block_28.out2, value=code_block_29.Height)
setparameterbyname_6 = Custom[SetParameterByName(TypeOrInstance)](element=element_setrotation_3, parameterName=code_block_28.out1, value=code_block_29.Depth)

# group: Partial Block Locations: Even Rows Start Locations Correct
zdirection_upanddown_10 = Vector.ZAxis()
Z_8 = Point.Z(point=partial_startpoint)
code_block_30 = CodeBlock(WallHeight=elementLenght_2, BlockHeight=elementHeight, z=Z_8) { WallHeight; BlockHeight; z; ShortWallHieght=WallHeight-z-BlockHeight; }
byStartPointDirectionLength_8 = Line.ByStartPointDirectionLength(startPoint=partial_startpoint, direction=zdirection_upanddown_10, length=code_block_30.ShortWallHieght)
half_of_element_height_9 = CodeBlock(ElementHeight=code_block_30.BlockHeight) { ElementHeight*2; X=ElementHeight; }
pointsAtChordLengthFromPoint_8 = Curve.PointsAtChordLengthFromPoint(curve=byStartPointDirectionLength_8, point=createandMergeList, chordLength=half_of_element_height_9.out0)
list_create_13 = List.Create(item0=partial_startpoint, item1=pointsAtChordLengthFromPoint_8)
transpose_13 = List.Transpose(lists=list_create_13)
startpoint_partial_even_2 = List.Flatten(list=transpose_13@@L4)

# group: Size Partail Blocks-Even Rows
zdirection_upanddown_11 = Vector.ZAxis()
translate_3 = Geometry.Translate(geometry=startpoint_partial_even_2, direction=zdirection_upanddown_11, distance=half_of_element_height_8.X)
translate_4 = Geometry.Translate(geometry=startpoint_partial_even, direction=zdirection_upanddown_11, distance=half_of_element_height_8.X)
byCornerPoints_3 = Rectangle.ByCornerPoints(p1=startpoint_partial_even, p2=startpoint_partial_even_2, p3=translate_3, p4=translate_4)
extrudeAsSolid_3 = Curve.ExtrudeAsSolid(curve=byCornerPoints_3, direction=elementHeight)
boundingBox_3 = Geometry.BoundingBox(geometry=extrudeAsSolid_3)
toCuboid_3 = BoundingBox.ToCuboid(boundingBox=boundingBox_3)

# group: Naming Partial Blocks by Size
width_3 = Cuboid.Width(cuboid=toCuboid_3)
code_block_31 = CodeBlock(x=width_3) { x*12; }
code_block_32 = CodeBlock { 2; }
round_3 = Math.Round(number=code_block_31, digits=code_block_32)
ꟿ_number_tostring_3 = Custom[ꟿ Number.ToString](num=round_3, digits=code_block_32)
code_block_33 = CodeBlock(x=ꟿ_number_tostring_3) { "8X8X"+x; }
string_from_object_3 = FromObject(object=code_block_33)
height_3 = Cuboid.Height(cuboid=toCuboid_3)

# group: Partail Block First Row Type Creation
categories_4 = Categories("OST_GenericModel")
file_path_3 = Filename("..\..\..\..\..\..\ProgramData\Autodesk\RVT 2023\Family Templates\English-Imperial\Generic Model.rft")
code_block_34 = CodeBlock { Material1=Material.ByName("Default"); }
code_block_35 = CodeBlock { "Generic Model"; }
byGeometry_3 = FamilyType.ByGeometry(solidGeometry=toCuboid_3, name=string_from_object_3, category=categories_4, templatePath=file_path_3, material=code_block_34, subcategory=code_block_35)
minPoint_3 = BoundingBox.MinPoint(boundingBox=boundingBox_3)
byPoint_4 = FamilyInstance.ByPoint(familyType=byGeometry_3, point=minPoint_3)
code_block_36 = CodeBlock(y=angleWithVector) { Math.Round(y,1); }
element_setrotation_4 = Custom[Element SetRotation](element=byPoint_4, degree=code_block_36)
setLocation_4 = Element.SetLocation(element=element_setrotation_4, geometry=startpoint_partial_even_2)
code_block_37 = CodeBlock { "Length"; "Depth"; "Height"; }
code_block_38 = CodeBlock(Depth=height_3, Height=height_3, Lenght=width_3) { Depth; Height; Lenght; }
setparameterbyname_7 = Custom[SetParameterByName(TypeOrInstance)](element=element_setrotation_4, parameterName=code_block_37.out0, value=code_block_38.Lenght)
setparameterbyname_8 = Custom[SetParameterByName(TypeOrInstance)](element=element_setrotation_4, parameterName=code_block_37.out1, value=code_block_38.Depth)
setparameterbyname_9 = Custom[SetParameterByName(TypeOrInstance)](element=element_setrotation_4, parameterName=code_block_37.out2, value=code_block_38.Height)

# group: Create Parameters Small Blocks
code_block_39 = CodeBlock { "Length"; "Depth"; "Height"; }  # frozen
boolean = BoolSelector(false)
categories_5 = Categories("OST_GenericModel")
list_create_14 = List.Create(item0=categories_5)
createProjectParameter = Parameter.CreateProjectParameter(parameterName=code_block_39.out1, groupName=code_block_39.out1, instance=boolean, categoryList=list_create_14)  # unwired: specType, groupType
createProjectParameter_2 = Parameter.CreateProjectParameter(parameterName=code_block_39.out2, groupName=code_block_39.out2, instance=boolean, categoryList=list_create_14)  # unwired: specType, groupType
createProjectParameter_3 = Parameter.CreateProjectParameter(parameterName=code_block_39.out0, groupName=code_block_39.out0, instance=boolean, categoryList=list_create_14)  # unwired: specType, groupType
