# Dynamo custom node ADMExtractWallReferanceEdges.dyf (Dynamo 2.13.1.3887)
# category: Mine
# packages: Genius Loci 2022.9.16

wall = Input(wall: var)
wall_edges_references = Custom[Wall Edges References](wall=wall)  # package Genius Loci; Get the vertical and horizontal edges and their references from the exterior and interior faces. Also works with linked walls.
code_block = CodeBlock { 1; }
cycle = List.Cycle(list=wall_edges_references.Exterior_Side_Horizontal_Edges, amount=code_block)
startPoint = Curve.StartPoint(curve=cycle)
Z = Point.Z(point=startPoint)
y = Input(y: var)
eq = Z == y
filterByBoolMask = List.FilterByBoolMask(list=cycle, mask=eq)
out = Output(filterByBoolMask.out)
