# Dynamo custom node ArrayPoints.dyf (Dynamo 2.13.1.3887)
# category: Mine

point = Input(point: Autodesk.DesignScript.Geometry.Point)
zdirection_upanddown = Vector.ZAxis()
WallHeight = Input(WallHeight: var[]..[])
BlockHeight = Input(BlockHeight: var[]..[])
Z = Point.Z(point=point)
adjustmentfactor = Input(adjustmentfactor: var[]..[])
code_block = CodeBlock(WallHeight=WallHeight, BlockHeight=BlockHeight, z=Z, a=adjustmentfactor) { WallHeight; BlockHeight; z; a; ShortWallHieght=WallHeight-(a*z); }
byStartPointDirectionLength = Line.ByStartPointDirectionLength(startPoint=point, direction=zdirection_upanddown, length=code_block.ShortWallHieght)
half_of_element_height = CodeBlock(ElementHeight=BlockHeight) { ElementHeight*2; }
pointsAtChordLengthFromPoint = Curve.PointsAtChordLengthFromPoint(curve=byStartPointDirectionLength, chordLength=half_of_element_height)
partialBlockCoordinates = Custom[PartialBlockCoordinates](point, pointsAtChordLengthFromPoint)
list = Output(partialBlockCoordinates)
