# Dynamo custom node BlockFamilyType.dyf (Dynamo 2.13.1.3887)
# category: Mine

solidGeometry = Input(solidGeometry: Autodesk.DesignScript.Geometry.Solid)
name = Input(name: string)
categories = Categories("OST_GenericModel")
file_path = Filename("..\..\..\..\..\..\ProgramData\Autodesk\RVT 2023\Family Templates\English-Imperial\Generic Model.rft")
code_block = CodeBlock { Material1=Material.ByName("Default"); }
code_block_2 = CodeBlock { "Generic Model"; }
byGeometry = FamilyType.ByGeometry(solidGeometry=solidGeometry, name=name, category=categories, templatePath=file_path, material=code_block, subcategory=code_block_2)
FamilyType = Output(byGeometry)
