# Dynamo custom node BlockParameters.dyf (Dynamo 2.13.1.3887)
# category: Mine

list = Input(list: var)
flatten = List.Flatten(list=list@L1)
element_dimiesions = CodeBlock { "DepthA"; "HeightA"; "LengthA"; }
block_depth = Element.GetParameterValueByName(element=flatten@L1, parameterName=element_dimiesions.out0)
Depth = Output(block_depth)
block_height = Element.GetParameterValueByName(element=flatten@L1, parameterName=element_dimiesions.out1)
Height = Output(block_height)
block_lenght = Element.GetParameterValueByName(element=flatten@L1, parameterName=element_dimiesions.out2)
Length = Output(block_lenght)
