# Dynamo graph Comp. Model Masonry Unit Generation.dyn (Dynamo 2.13.1.3887)
# packages: Clockwork for Dynamo 2.x 2.6.0, Modelical 2.2.9, RIE 2021.7.1, Genius Loci 2022.9.16, bimorphNodes 5.1.2, archi-lab.net 2022.210.2122

code_block = CodeBlock {  }
maximumItemByKey = List.MaximumItemByKey()  # unwired: list, keyFunction
maximumItemByKey_2 = List.MaximumItemByKey()  # unwired: list, keyFunction
code_block_2 = CodeBlock {  }

# group: Project Setup
categories = Categories("OST_Walls")
all_elements_of_category = ElementsOfCategory(Category=categories)
wall_material_number = Element.GetMaterials(element=all_elements_of_category)
name = Material.Name(material=wall_material_number)
material_libarary_location = Directory("C:\Users\Austin\OneDrive - The Pennsylvania State University\497 Dr. Hu\Class Project\CMU")
loadNeededElementsForWalls = Custom[LoadNeededElementsForWalls](WallMaterials=name, Directory=material_libarary_location)
loadFamily = Custom[Document.LoadFamily](path=loadNeededElementsForWalls)  # package Clockwork for Dynamo 2.x; A very crude implementation of family loading. Will *not* reload an already loaded family of the same name.
unjoinAllGeometry = Element.UnjoinAllGeometry(elements=all_elements_of_category)
string = StringInput("Unconnected Height")
wall_heights = Element.GetParameterValueByName(element=unjoinAllGeometry, parameterName=string)
ADMExtractWallReferanceEdges = Custom[ADMExtractWallReferanceEdges](wall=unjoinAllGeometry, y=wall_heights)
blockParameters = Custom[BlockParameters](list=loadFamily.familyTypes@L1)
flatten = List.Flatten(list=blockParameters.Length)
flatten_2 = List.Flatten(list=blockParameters.Height)
flatten_3 = List.Flatten(list=blockParameters.Depth)

# group: Full Block Locations
startPoint = Curve.StartPoint(curve=ADMExtractWallReferanceEdges)
code_block_3 = CodeBlock { 1; }
ZAxis = Vector.ZAxis()
code_block_4 = CodeBlock { 4; }
code_block_5 = CodeBlock { 2; }
mul = flatten_2 * code_block_5
code_block_6 = CodeBlock { 1; }
ZAxis_2 = Vector.ZAxis()
RIE_Wall_GetDirections = Custom[RIE_Wall_GetDirections](walls=unjoinAllGeometry)  # package RIE; Returns Vectors for Wall direction, Walls interior side normal, Walls exterior side normal
integer_slider = IntegerSlider(50, range=0..100 step 1)
code_block_7 = CodeBlock(y=integer_slider, X=flatten) { Y=y/100; X*Y; }
XAxis = Vector.XAxis()
angleBetweenVectorsInXY_CW_CCW = Custom[AngleBetweenVectorsInXY_CW_CCW](RefVector=XAxis, vector=RIE_Wall_GetDirections.direction)  # package Modelical; Returns the angle that forms a vector with another reference vector, clockwise and counterclockwise. The vectors are calculated in the XY plane.
watch = Watch(angleBetweenVectorsInXY_CW_CCW.Counterclockwise)
flatten_4 = List.Flatten(list=watch)
ZAxis_3 = Vector.ZAxis()

# group: Opening Lower Coordinates
wallInserts = Custom[WallInserts](unjoinAllGeometry)  # package Modelical; Get all the inserts in a wall (windows, doors and openings).
boundingBox = Element.BoundingBox(element=wallInserts)
minPoint = BoundingBox.MinPoint(boundingBox=boundingBox)
Z = Point.Z(point=minPoint)
code_block_8 = CodeBlock(x=wall_heights, y=Z) { x; x-x; y-x+x; }
replaceEmptyLists = Custom[List.ReplaceEmptyLists](seq=Z@L2, Replacement=code_block_8.out2)  # package Clockwork for Dynamo 2.x; Replaces all empty lists within a given list with a substitute
flatten_5 = List.Flatten(list=replaceEmptyLists)
Z_2 = Point.Z(point=startPoint)
eq = flatten_5 == Z_2

# group (continued): Full Block Locations
filterByBoolMask = List.FilterByBoolMask(list=ADMExtractWallReferanceEdges, mask=eq)
startPoint_2 = Curve.StartPoint(curve=filterByBoolMask.out)
watch_2 = Watch(filterByBoolMask.out)
pointsAtSegmentLengthFromPoint = Curve.PointsAtSegmentLengthFromPoint(curve=watch_2, point=startPoint_2, segmentLength=flatten)
dropLastItem = Custom[List.DropLastItem](list=pointsAtSegmentLengthFromPoint@@L2)  # package Clockwork for Dynamo 2.x; Drops the last item from a given list.
flatten_6 = List.Flatten(list=dropLastItem@@L3, amount=code_block_3)
createandMergeList = Custom[CreateandMergeList](startPoint_2, flatten_6)
Z_3 = Point.Z(point=createandMergeList)
round = Math.Round(number=Z_3, digits=code_block_4)
sub = wall_heights - round
byStartPointDirectionLength = Line.ByStartPointDirectionLength(startPoint=createandMergeList, direction=ZAxis, length=sub)
pointsAtSegmentLengthFromPoint_2 = Curve.PointsAtSegmentLengthFromPoint(curve=byStartPointDirectionLength, point=createandMergeList, segmentLength=mul)
flatten_7 = List.Flatten(list=pointsAtSegmentLengthFromPoint_2@@L3, amount=code_block_6)
createandMergeList_2 = Custom[CreateandMergeList](createandMergeList, flatten_7)
translate = Geometry.Translate(geometry=createandMergeList_2, direction=ZAxis_2, distance=flatten_2)
translate_2 = Geometry.Translate(geometry=translate, direction=RIE_Wall_GetDirections.direction, distance=code_block_7.out1)

# group: Full Block Placement
flatten_8 = List.Flatten(list=loadFamily.familyTypes)
createandMergeList_3 = Custom[CreateandMergeList](createandMergeList_2, translate_2)
Z_4 = Point.Z(point=createandMergeList_3)
eq_2 = Z_4 == wall_heights
filterByBoolMask_2 = List.FilterByBoolMask(list=createandMergeList_3, mask=eq_2)
watch_3 = Watch(filterByBoolMask_2.out)
Z_5 = Point.Z(point=watch_3)
le = Z_5 <= wall_heights
filterByBoolMask_3 = List.FilterByBoolMask(list=watch_3, mask=le)
watch_4 = Watch(filterByBoolMask_3.in)
byPoint = FamilyInstance.ByPoint(familyType=flatten_8, point=watch_4)
element_setrotation = Custom[Element SetRotation](element=byPoint, degree=flatten_4)  # package Genius Loci; Set the angle of the element around its local Z-axis. (Same as the Rotate command in Revit)
setLocation = Element.SetLocation(element=element_setrotation, geometry=watch_4)

# group: Odd Row Partial Blocks
lastItem = List.LastItem(list=pointsAtSegmentLengthFromPoint@@L2)
ZAxis_4 = Vector.ZAxis()
byStartPointDirectionLength_2 = Line.ByStartPointDirectionLength(startPoint=lastItem, direction=ZAxis_4, length=sub)
pointsAtSegmentLengthFromPoint_3 = Curve.PointsAtSegmentLengthFromPoint(curve=byStartPointDirectionLength_2, point=lastItem, segmentLength=mul)
flatten_9 = List.Flatten(list=pointsAtSegmentLengthFromPoint_3@@L3, amount=code_block_6)
createandMergeList_4 = Custom[CreateandMergeList](flatten_9, lastItem)
endPoint = Curve.EndPoint(curve=filterByBoolMask.out)
byStartPointDirectionLength_3 = Line.ByStartPointDirectionLength(startPoint=endPoint, direction=ZAxis_4, length=sub)
pointsAtSegmentLengthFromPoint_4 = Curve.PointsAtSegmentLengthFromPoint(curve=byStartPointDirectionLength_3, point=endPoint, segmentLength=mul)
flatten_10 = List.Flatten(list=pointsAtSegmentLengthFromPoint_4@@L3, amount=code_block_6)
createandMergeList_5 = Custom[CreateandMergeList](flatten_10, endPoint)
ZAxis_5 = Vector.ZAxis()
translate_3 = Geometry.Translate(geometry=createandMergeList_5, direction=ZAxis_5, distance=flatten_2)
translate_4 = Geometry.Translate(geometry=createandMergeList_4, direction=ZAxis_5, distance=flatten_2)
byCornerPoints = Rectangle.ByCornerPoints(p1=createandMergeList_4, p2=createandMergeList_5, p3=translate_3, p4=translate_4)

# group: Even Row Partial Blocks
lastItem_2 = List.LastItem(list=pointsAtSegmentLengthFromPoint@@L2)
ZAxis_6 = Vector.ZAxis()
translate_5 = Geometry.Translate(geometry=lastItem_2, direction=ZAxis_6, distance=flatten_2)
code_block_9 = CodeBlock(x=flatten) { x/2; }
translate_6 = Geometry.Translate(geometry=translate_5, direction=RIE_Wall_GetDirections.direction, distance=code_block_9)
ZAxis_7 = Vector.ZAxis()
byStartPointDirectionLength_4 = Line.ByStartPointDirectionLength(startPoint=translate_6, direction=ZAxis_7, length=sub)
pointsAtSegmentLengthFromPoint_5 = Curve.PointsAtSegmentLengthFromPoint(curve=byStartPointDirectionLength_4, point=translate_6, segmentLength=mul)
flatten_11 = List.Flatten(list=pointsAtSegmentLengthFromPoint_5@@L3, amount=code_block_6)
createandMergeList_6 = Custom[CreateandMergeList](flatten_11, translate_6)
endPoint_2 = Curve.EndPoint(curve=filterByBoolMask.out)
translate_7 = Geometry.Translate(geometry=endPoint_2, direction=ZAxis_6, distance=flatten_2)
translate_8 = Geometry.Translate(geometry=translate_7, direction=RIE_Wall_GetDirections.direction, distance=code_block_9)
byStartPointDirectionLength_5 = Line.ByStartPointDirectionLength(startPoint=translate_8, direction=ZAxis_7, length=sub)
pointsAtSegmentLengthFromPoint_6 = Curve.PointsAtSegmentLengthFromPoint(curve=byStartPointDirectionLength_5, point=translate_8, segmentLength=mul)
flatten_12 = List.Flatten(list=pointsAtSegmentLengthFromPoint_6@@L3, amount=code_block_6)
createandMergeList_7 = Custom[CreateandMergeList](flatten_12, translate_8)
ZAxis_8 = Vector.ZAxis()
translate_9 = Geometry.Translate(geometry=createandMergeList_7, direction=ZAxis_8, distance=flatten_2)
translate_10 = Geometry.Translate(geometry=createandMergeList_6, direction=ZAxis_8, distance=flatten_2)
byCornerPoints_2 = Rectangle.ByCornerPoints(p1=createandMergeList_6, p2=createandMergeList_7, p3=translate_9, p4=translate_10)

# group: Partial Block Generation
createandMergeList_8 = Custom[CreateandMergeList](byCornerPoints, byCornerPoints_2)
extrudeAsSolid = Curve.ExtrudeAsSolid(curve=createandMergeList_8, direction=RIE_Wall_GetDirections.interior_normal, distance=flatten_3)
boundingBox_2 = Geometry.BoundingBox(geometry=extrudeAsSolid)
toCuboid = BoundingBox.ToCuboid(boundingBox=boundingBox_2)
namePartailBlocks = Custom[NamePartailBlocks](cuboid=toCuboid)
blockFamilyType = Custom[BlockFamilyType](solidGeometry=toCuboid, name=namePartailBlocks.string)
minPoint_2 = BoundingBox.MinPoint(boundingBox=boundingBox_2)
byPoint_2 = FamilyInstance.ByPoint(familyType=blockFamilyType, point=minPoint_2)
code_block_10 = CodeBlock { Math.Round(y,1); }  # unwired: y
element_setrotation_2 = Custom[Element SetRotation](element=byPoint_2, degree=code_block_10)  # frozen
setPartialBlockParameters = Custom[SetPartialBlockParameters](Depth=namePartailBlocks.double1, Lenght=namePartailBlocks.double0, element=element_setrotation_2)
code_block_11 = CodeBlock { 2; }
flatten_13 = List.Flatten(list=byPoint_2@@L3, amount=code_block_11)

# group: Delete Units in Openings
replaceEmptyLists_2 = Custom[List.ReplaceEmptyLists](seq=boundingBox@L2, Replacement=code_block_8.out2)
flatten_14 = List.Flatten(list=replaceEmptyLists_2)
createandMergeList_9 = Custom[CreateandMergeList](element_setrotation, flatten_13)
code_block_12 = CodeBlock { 0.6; 0; -0.1; }
getElementsInside = Revit.BoundingBox.GetElementsInside(boundingBox=flatten_14, elements=createandMergeList_9@L1, tolerance=code_block_12.out0)
delete = Element.Delete(element=getElementsInside)
flatten_15 = List.Flatten(list=createandMergeList_9)
clear_list = Custom[Clear List](input=flatten_15)  # package archi-lab.net; This node will remove all Null and Empty Lists from any list.
location = Custom[Element.Location+](element=createandMergeList_9)  # package Clockwork for Dynamo 2.x; Returns the location of an element as point, curve or curve loop, along with some booleans to help filtering the results. Unlike the OOTB Element.GetLocation node, it also returns sketch lines of sketch-based elements like floor slabs as well as the element's rotation property. Additionally, it supports quite a few more element types (e.g. railings, stairs etc.).
Z_6 = Point.Z(point=location.points)
code_block_13 = CodeBlock { 10; }
eq_3 = Equals(x=Z_6, y=code_block_13)
filterByBoolMask_4 = List.FilterByBoolMask(list=clear_list, mask=eq_3)
delete_2 = Element.Delete(element=filterByBoolMask_4.in)
getElementsIntersect = Revit.BoundingBox.GetElementsIntersect(boundingBox=flatten_14, elements=createandMergeList_9@L1, tolerance=code_block_12.out1)

# group: Window opening overlap removal
toCuboid_2 = BoundingBox.ToCuboid(boundingBox=flatten_14)
getElementsIntersect_2 = Revit.BoundingBox.GetElementsIntersect(boundingBox=flatten_14, elements=createandMergeList_9, tolerance=code_block_12.out2)
location_2 = archilab.Revit.Elements.Elements.Location(element=getElementsIntersect_2)
byStartPointDirectionLength_6 = Line.ByStartPointDirectionLength(startPoint=location_2, direction=RIE_Wall_GetDirections.direction, length=flatten)
code_block_14 = CodeBlock { true; }
solidIntersection = Curve.SolidIntersection(solid=toCuboid_2, curves=byStartPointDirectionLength_6, invert=code_block_14)
curveSegments = Results.CurveSolidIntersectionResult.CurveSegments(curveSolidIntersectionResult=solidIntersection)
startPoint_3 = Curve.StartPoint(curve=curveSegments)
endPoint_3 = Curve.EndPoint(curve=curveSegments)
ZAxis_9 = Vector.ZAxis()
translate_11 = Geometry.Translate(geometry=curveSegments, direction=ZAxis_9, distance=flatten_2)
endPoint_4 = Curve.EndPoint(curve=translate_11)
startPoint_4 = Curve.StartPoint(curve=translate_11)
byCornerPoints_3 = Rectangle.ByCornerPoints(p1=startPoint_3@@L2, p2=endPoint_3@L2, p3=endPoint_4@L2, p4=startPoint_4@L2)
code_block_15 = CodeBlock { 1; }
flatten_16 = List.Flatten(list=getElementsIntersect_2@@L2, amount=code_block_15)
delete_3 = Element.Delete(element=flatten_16)
code_block_16 = CodeBlock { 2; }
flatten_17 = List.Flatten(list=curveSegments, amount=code_block_16)

# group: Partial Block Generation
extrudeAsSolid_2 = Curve.ExtrudeAsSolid(curve=byCornerPoints_3@L2, direction=RIE_Wall_GetDirections.interior_normal, distance=flatten_3)
boundingBox_3 = Geometry.BoundingBox(geometry=extrudeAsSolid_2)
toCuboid_3 = BoundingBox.ToCuboid(boundingBox=boundingBox_3)
namePartailBlocks_2 = Custom[NamePartailBlocks](cuboid=toCuboid_3)
blockFamilyType_2 = Custom[BlockFamilyType](solidGeometry=toCuboid_3, name=namePartailBlocks_2.string)
minPoint_3 = BoundingBox.MinPoint(boundingBox=boundingBox_3)
byPoint_3 = FamilyInstance.ByPoint(familyType=blockFamilyType_2, point=minPoint_3)
code_block_17 = CodeBlock { Math.Round(y,1); }  # unwired: y
element_setrotation_3 = Custom[Element SetRotation](element=byPoint_3, degree=code_block_17)  # frozen
setPartialBlockParameters_2 = Custom[SetPartialBlockParameters](Depth=namePartailBlocks_2.double1, Lenght=namePartailBlocks_2.double0, element=element_setrotation_3)
code_block_18 = CodeBlock { 2; }
flatten_18 = List.Flatten(list=byPoint_3@@L3, amount=code_block_18)
