# Dynamo custom node CreateandMergeList.dyf (Dynamo 2.13.1.3887)
# category: Mine

Input = Input(: var[]..[])
Input_2 = Input(: var[]..[])
list_create = List.Create(item0=Input, item1=Input_2)
transpose = List.Transpose(lists=list_create@L4)
allFirstRowCoordinates = List.Flatten(list=transpose@L3)
list = Output(allFirstRowCoordinates)
