# Dynamo custom node FilterOutUpperReferanceEdge.dyf (Dynamo 2.13.1.3887)
# category: MineFil
# packages: archi-lab.net 2022.210.2122

curve = Input(curve: Autodesk.DesignScript.Geometry.Curve)
referance_edge_start_locations = Curve.StartPoint(curve=curve)
Z = Point.Z(point=referance_edge_start_locations)
wall_start_z = Point.X(point=referance_edge_start_locations)
Y = Point.Y(point=referance_edge_start_locations)
z = Input(z: double)
byCoordinates = Point.ByCoordinates(x=wall_start_z, y=Y, z=z)
Z_2 = Point.Z(point=byCoordinates)
eq = Z == Z_2
filterByBoolMask = List.FilterByBoolMask(list=curve, mask=eq)
clean = archilab.Lists.Lists.Clean(list=filterByBoolMask.out)
out = Output(clean)
