# Dynamo graph INFOEXTRACTION.dyn (Dynamo 2.13.1.3887)
# packages: Modelical 2.2.9, archi-lab.net 2022.210.2122

select_model_elements = DSModelElementsSelection()  # 2416 picked in the model
getInternal = archilab.Revit.Units.Units.GetInternal()
forge_specs = ForgeSpecsUi("autodesk.spec.aec:length-2.0.0")

# group: Set Up Parameters
surveyPoint = Coordinates.SurveyPoint()
byOrigin = CoordinateSystem.ByOrigin(origin=surveyPoint)
familyType = Custom[FamilyInstance.FamilyType](familyInstance=select_model_elements)  # package archi-lab.net; This node will return a Family Type of a given Family Instance. If no Family Type can be assigned to a Family then it will return Null.
string = StringInput("LengthA")
getParameterValueByName = Element.GetParameterValueByName(element=familyType, parameterName=string)
string_2 = StringInput("DepthA")
getParameterValueByName_2 = Element.GetParameterValueByName(element=familyType, parameterName=string_2)

# group: Data Extraction
id = Element.Id(element=select_model_elements)
name = Element.Name(element=select_model_elements)
getLocation = Element.GetLocation(element=select_model_elements)
transform = Geometry.Transform(geometry=getLocation, cs=byOrigin)
getElementRotation = Custom[GetElementRotation](FamInstance=select_model_elements)  # package Modelical; Get the rotation of a family instance whose location is a point.
code_block = CodeBlock(x=getParameterValueByName, y=getParameterValueByName_2) { x/2; y/2; }
code_block_2 = CodeBlock { 0; }
byCoordinates = Vector.ByCoordinates(x=code_block.out0, y=code_block.out1, z=code_block_2)
ZAxis = Vector.ZAxis()

# group: Points
X = Point.X(point=transform)
Y = Point.Y(point=transform)
Z = Point.Z(point=transform)
code_block_3 = CodeBlock(x=getElementRotation.Rotation) { 360-x; }

# group (continued): Data Extraction
rotate = Vector.Rotate(vector=byCoordinates, axis=ZAxis, degrees=code_block_3)

# group (continued): Points
add = Point.Add(point=transform, vectorToAdd=rotate)
X_2 = Point.X(point=add)
Y_2 = Point.Y(point=add)
Z_2 = Point.Z(point=add)

# group: Units
code_block_4 = CodeBlock(x=X) { Math.Round(x, 4); }
code_block_5 = CodeBlock(y=Y) { Math.Round(y,4); }
code_block_6 = CodeBlock(z=Z) { Math.Round(z, 4); }
code_block_7 = CodeBlock(z=code_block_3) { Math.Round(z, 0); }
code_block_8 = CodeBlock(y=X_2) { Math.Round(y,4); }
code_block_9 = CodeBlock(y=Y_2) { Math.Round(y,4); }
code_block_10 = CodeBlock(y=Z_2) { Math.Round(y,4); }

format = archilab.Revit.Units.UnitUtils.Format(units=getInternal, forgeSpec=forge_specs, value=code_block_4)
format_2 = archilab.Revit.Units.UnitUtils.Format(units=getInternal, forgeSpec=forge_specs, value=code_block_5)
format_3 = archilab.Revit.Units.UnitUtils.Format(units=getInternal, forgeSpec=forge_specs, value=code_block_6)
forge_units = ForgeUnitsUi("autodesk.unit.unit:metersCentimeters-1.0.0")
convertFromInternalUnits = archilab.Revit.Units.UnitUtils.ConvertFromInternalUnits(value=code_block_8, forgeUnit=forge_units)
convertFromInternalUnits_2 = archilab.Revit.Units.UnitUtils.ConvertFromInternalUnits(value=code_block_9, forgeUnit=forge_units)
convertFromInternalUnits_3 = archilab.Revit.Units.UnitUtils.ConvertFromInternalUnits(value=code_block_10, forgeUnit=forge_units)

# group: Excel and Formating
file_path = Filename(".\Project Exports")
string_3 = StringInput("Sequence Building")
number = DoubleInput(0)
code_block_11 = CodeBlock { ["ID"]; ["Type"]; ["x"]; ["y"]; ["z"]; ["Rotation"]; }
list_create = List.Create(item0=code_block_11.out0, item1=code_block_11.out1, item2=code_block_11.out2, item3=code_block_11.out3, item4=code_block_11.out4, item5=code_block_11.out5)
transpose = List.Transpose(lists=list_create)
list_create_2 = List.Create(item0=id, item1=name, item2=format, item3=format_2, item4=format_3, item5=code_block_7)
transpose_2 = List.Transpose(lists=list_create_2)
join = List.Join(list0=transpose, list1=transpose_2)
code_block_12 = CodeBlock { true; }
us_standard_sheet = Data.ExportExcel(filePath=file_path, sheetName=string_3, startRow=number, startColumn=number, data=join, overWrite=code_block_12)
string_4 = StringInput("Sequence Robot")
list_create_3 = List.Create(item0=id, item1=name, item2=convertFromInternalUnits, item3=convertFromInternalUnits_2, item4=convertFromInternalUnits_3, item5=code_block_7)
transpose_3 = List.Transpose(lists=list_create_3)
join_2 = List.Join(list0=transpose, list1=transpose_3)
metric_sheet = Data.ExportExcel(filePath=file_path, sheetName=string_4, startRow=number, startColumn=number, data=join_2, overWrite=code_block_12)
