# Dynamo custom node LoadNeededElementsForWalls.dyf (Dynamo 2.13.1.3887)
# category: archilab

WallMaterials = Input(WallMaterials: var[])
Directory = Input(Directory: var[])
python_script = Python(IN[0]=WallMaterials, IN[1]=Directory)  # CPython3
# ---------- python_script.python (32 lines) ----------
# Load the Python Standard and DesignScript Libraries
import os
import sys
import clr
clr.AddReference('ProtoGeometry')
from Autodesk.DesignScript.Geometry import *
from System.Collections.Generic import *
from Autodesk.DesignScript.Geometry import *

# The inputs to this node will be stored as a list in the IN variables.
dirs = IN[0]
parentDir = IN[1][0]

# Start
try:
	absDirs = []
	filenames = []
	for d in dirs:	
		absPath = os.path.join(parentDir, d)
		absDirs.append(absPath)	
		if not os.path.exists(absPath):
				os.makedirs(absPath)
		for f in os.listdir(absPath):
			fAbsPath = os.path.join(absPath, f)
			if os.path.isfile(fAbsPath):
				filenames.append(fAbsPath)
			
					
		
	OUT = filenames
except Exception as e:
	OUT = str(e)
# ----------------------------------------
ElemenentPath = Output(python_script)
