# Dynamo custom node MergeAndTraspose.dyf (Dynamo 2.13.1.3887)
# category: Revit

lists = Input(lists: var)
transpose = List.Transpose(lists=lists@L4)
flatten = List.Flatten(list=transpose@L3)
list = Output(flatten)
