# Dynamo custom node NamePartailBlocks.dyf (Dynamo 2.13.1.3887)
# category: Mine

cuboid = Input(cuboid: Autodesk.DesignScript.Geometry.Cuboid)
width = Cuboid.Width(cuboid=cuboid)
double = Output(width)
height = Cuboid.Height(cuboid=cuboid)
double_2 = Output(height)  # "double"
code_block = CodeBlock(x=width) { x*12; }
code_block_2 = CodeBlock { 2; }
round = Math.Round(number=code_block, digits=code_block_2)
ꟿ_number_tostring = Custom[ꟿ Number.ToString](num=round, digits=code_block_2)  # Converts the input number(s) to string. You can optionally limit the number of digits.
code_block_3 = CodeBlock(x=ꟿ_number_tostring) { "8X8X"+x; }
string_from_object = FromObject(object=code_block_3)
string = Output(string_from_object)
