# Dynamo custom node SetPartialBlockParameters.dyf (Dynamo 2.13.1.3887)
# category: Mine
# packages: Rhythm 2017.1.8

element = Input(element: Revit.Elements.Element)
setLocation = Element.SetLocation(element=element)  # unwired: geometry
void = Output(setLocation)
code_block = CodeBlock { "Length"; "Depth"; "Height"; }
Depth = Input(Depth: var[]..[])
Lenght = Input(Lenght: var[]..[])
code_block_2 = CodeBlock(Depth=Depth, Height=Depth, Lenght=Lenght) { Depth; Height; Lenght; }
setparameterbyname = Custom[SetParameterByName(TypeOrInstance)](element=element, parameterName=code_block.out0, value=code_block_2.Lenght)  # package Rhythm; Set one of the element's parameters regardless of parameter type or instance.
Element = Output(setparameterbyname)
setparameterbyname_2 = Custom[SetParameterByName(TypeOrInstance)](element=element, parameterName=code_block.out2, value=code_block_2.Height)
Element_2 = Output(setparameterbyname_2)  # "Element"
setparameterbyname_3 = Custom[SetParameterByName(TypeOrInstance)](element=element, parameterName=code_block.out1, value=code_block_2.Depth)
Element_3 = Output(setparameterbyname_3)  # "Element"
code_block_3 = CodeBlock {  }
code_block_4 = CodeBlock {  }
code_block_5 = CodeBlock {  }
